# Grasshopper definition Sarrento.gh (Grasshopper 1.0.4)
# plug-ins: EleFront, Bifocals, MetaHopper, Telepathy

main_position_x = Slider(0, range=0..100)
main_position_y = Slider(0, range=0..100)
main_position_x_2 = RemoteSender(main_position_x)
main_position_y_2 = RemoteSender(main_position_y)

rectangle_x_size = Slider(328, range=0..1000)
rectangle_y_size = Slider(812, range=0..2000)
start_step = Slider(18.5, range=0..100)
rectangle_x_size_2 = RemoteSender(rectangle_x_size)
rectangle_y_size_2 = RemoteSender(rectangle_y_size)
start_step_2 = RemoteSender(start_step)

start_point = ConstructPoint(XCoordinate=main_position_x, YCoordinate=main_position_y, ZCoordinate=0)

rectangle_x_size_3 = RemoteReceiver(rectangle_x_size_2)
start_step_3 = RemoteReceiver(start_step_2)
main_position_y_3 = RemoteReceiver(main_position_y_2)
rectangle_x_size_4 = RemoteReceiver(rectangle_x_size_2)
rectangle_y_size_3 = RemoteReceiver(rectangle_y_size_2)

division = Division(A=rectangle_x_size_3, B=2)
main_rectangle = Rectangle(Plane=start_point, XSize=rectangle_x_size_4, YSize=rectangle_y_size_3, Radius=0)  # -> Rectangle, Length
pt = PointOriented(BasePlane=start_point, UComponent=start_step_3, VComponent=rectangle_y_size_3, WComponent=0)
pt_2 = PointOriented(BasePlane=start_point, UComponent=start_step_3, VComponent=main_position_y_3, WComponent=0)
rectangle_centre = PointOriented(BasePlane=start_point, UComponent=division, VComponent=main_position_y_3, WComponent=0)
Y = UnitY(Factor=1)
ln = Line(StartPoint=pt, EndPoint=pt_2)
line = LineSDL(Start=rectangle_centre, Direction=Y, Length=1)
mirror = MirrorCurve(Geometry=ln, Curve=line, Tangent=True)

# ----
# tween generator
# В формуле число 30 выступает в кач-ве
# суммы ширины прохода фрезы и
# необходимого размера "островка".
rectangle_x_size_5 = RemoteReceiver(rectangle_x_size_2)
start_step_4 = RemoteReceiver(start_step_2)
expression = Expression(rec_x_size=rectangle_x_size_5, start_step=start_step_4, Expression="(rec_x_size - (start_step * 2)) \ 30")
range = Range(Domain=Domain(0, 1), Steps=expression)
tweencrv = TweenCurve(CurveA=ln, CurveB=mirror, Factor=range, BlendType=0)

merge = Merge(Data1=ln, Data2=mirror, Data3=main_rectangle.Rectangle, Data4=tweencrv)
bake = BakeObjects(Geometry=merge, Bake=False)

wiredisplay = ControlWireDisplay(WireDisplay=2, AllObjects_Object=tweencrv)
hideshow = HideShowObjectPreview(Visible=False, AllObjects_Object=[start_point, pt, pt_2, rectangle_centre])
