# Grasshopper definition Sarrento_cbd.gh (Grasshopper 1.0.4)
# plug-ins: Human UI, EleFront, Bifocals, MetaHopper, Telepathy

main_position_x = Slider(0, range=0..100)
main_position_y = Slider(0, range=0..100)
main_position_x_2 = RemoteSender(main_position_x)
main_position_y_2 = RemoteSender(main_position_y)

rectangle_x_size = Slider(280, range=0..2000)
rectangle_y_size = Slider(400, range=0..2000)
start_step = Slider(19, range=0..100)

# ----
# start point
pt = Point(Point(0, 0, 0))
pdecon = Deconstruct(Point=pt)  # -> XComponent, YComponent, ZComponent
pt_2 = ConstructPoint(XCoordinate=pdecon.XComponent, YCoordinate=pdecon.YComponent, ZCoordinate=0)

slider = CreateSlider(RecXSize=rectangle_x_size, ShowBounds=False, showLabel=True, ShowTicks=False, ShowTooltip=False, ShowValLabel=True)
slider_2 = CreateSlider(RecYSize=rectangle_y_size, ShowBounds=False, showLabel=True, ShowTicks=False, ShowTooltip=False, ShowValLabel=True)
slider_3 = CreateSlider(RecYSize=start_step, ShowBounds=False, showLabel=True, ShowTicks=False, ShowTooltip=False, ShowValLabel=True)
# ui movement
toggle = BooleanToggle(True)
launchwin = LaunchWindow(Show=toggle, Name="Control Window", Width=370, Height=400, ChildStatus=0, EnableHorizScroll=False)
values = ValueListener(Elements=slider, SomeProperty=True)  # -> Values, Indices
values_2 = ValueListener(Elements=slider_2, SomeProperty=True)  # -> Values, Indices
addelems = AddElements(Window=launchwin, Elements=flatten([slider, slider_2, slider_3]), DoVLChecking=True)  # -> AddedElements, ElementNames
values_3 = ValueListener(Elements=slider_3, SomeProperty=True)  # -> Values, Indices
land_step = Slider(4, range=0..100)
rectangle_x_size_2 = RemoteSender(values.Values)
rectangle_y_size_2 = RemoteSender(values_2.Values)
start_step_2 = RemoteSender(values_3.Values)

rectangle_x_size_3 = RemoteReceiver(rectangle_x_size_2)
start_step_3 = RemoteReceiver(start_step_2)
main_position_y_3 = RemoteReceiver(main_position_y_2)
rectangle_x_size_4 = RemoteReceiver(rectangle_x_size_2)
rectangle_y_size_3 = RemoteReceiver(rectangle_y_size_2)

division = Division(A=rectangle_x_size_3, B=2)
main_rectangle = Rectangle(Plane=pt_2, XSize=rectangle_x_size_4, YSize=rectangle_y_size_3, Radius=0)  # -> Rectangle, Length
pt_3 = PointOriented(BasePlane=pt_2, UComponent=start_step_3, VComponent=rectangle_y_size_3, WComponent=0)
pt_4 = PointOriented(BasePlane=pt_2, UComponent=start_step_3, VComponent=main_position_y_3, WComponent=0)
rectangle_centre = PointOriented(BasePlane=pt_2, UComponent=division, VComponent=main_position_y_3, WComponent=0)
Y = UnitY(Factor=1)
ln = Line(StartPoint=pt_3, EndPoint=pt_4)
line = LineSDL(Start=rectangle_centre, Direction=Y, Length=1)
mirror = MirrorCurve(Geometry=ln, Curve=line, Tangent=True)

# ----
# tween generator
# В формуле число 30 выступает в кач-ве
# суммы ширины прохода фрезы и
# необходимого размера "островка".
rectangle_x_size_5 = RemoteReceiver(rectangle_x_size_2)
start_step_4 = RemoteReceiver(start_step_2)
mill_step = Slider(25, range=0..100)
mill_step_2 = RemoteSender(mill_step)
expression = Expression(
    rec_x_size=rectangle_x_size_5,
    start_step=start_step_4,
    mill_step=mill_step_2,
    land_step=land_step,
    Expression="(rec_x_size - (start_step * 2)) \ (mill_step + land_step)")
tween_generator_result = RemoteSender(expression)
range = Range(Domain=Domain(0, 1), Steps=expression)
tweencrv = TweenCurve(CurveA=ln, CurveB=mirror, Factor=range, BlendType=0)
flatten = FlattenTree(Tree=tweencrv, Path="{0}")

merge = Merge(Data1=main_rectangle.Rectangle, Data2=tweencrv)
bake = BakeObjects(Geometry=merge, Bake=False)
cluster = Cluster(tween_generator_result=tween_generator_result)
python = GhPythonScript(amount_of_lines=expression, step_between_lines=cluster)  # -> out, a
# ---------- python: Python ----------
__author__ = "vostorg"
__version__ = "2023.10.07"

import rhinoscriptsyntax as rs
print("=====================")
print("amount of lines:", amount_of_lines + 1)
print("=====================")
print("step between lines:", step_between_lines)
# ---------- end python ----------
result = Panel(python.out)
start_point = ConstructPoint(XCoordinate=main_position_x, YCoordinate=main_position_y, ZCoordinate=0)

wiredisplay = ControlWireDisplay(WireDisplay=2, AllObjects_Object=[slider, slider_2])
hideshow = HideShowObjectPreview(Visible=False, AllObjects_Object=[start_point, pt_3, pt_4, rectangle_centre])

# ==== cluster Cluster
tween_generator_result = ClusterInput()
rectangle_x_size = ClusterInput()
tween_generator_result_2 = RemoteReceiver(tween_generator_result)
rectangle_x_size_2 = RemoteReceiver(rectangle_x_size)
division = Division(A=rectangle_x_size_2, B=tween_generator_result_2)
R = ClusterOutput(division)
