# Grasshopper definition automaticpolygondimensions.gh (Grasshopper 1.0.7)
# plug-ins: EleFront, Pufferfish

# Automatic Polygon Dimensions
# guillermo@mcneel.com
curves = GetGeometry(AtLeast=1, AtMost=1000, DeleteInput=False, Filter=1073741828, Prompt="Select the curves to be dimensioned")
cir = Circle(Plane=PlaneXY(0, 0, 0), Radius=1)
flip = FlipCurve(Curve=cir)  # -> Curve, Flag
get_boolean = GetBoolean(
    AtLeast=1,
    AtMost=1,
    FalseValue="Triangulation",
    Prompt="Do you prefer interior Angles or Triangulation?",
    TrueValue="Angles")
get_boolean_2 = GetBoolean(AtLeast=1, AtMost=1, FalseValue="No", Prompt="Do you want to obtain also Bounding Box Dimensions?", TrueValue="Yes")
flip_2 = FlipCurve(Curve=curves, Guide=flip.Curve)  # -> Curve, Flag
disc = Discontinuity(Curve=flip_2.Curve, Level=1)  # -> Points, Parameters
gate = StreamGate(Stream=curves, Gate=get_boolean_2)  # -> Target0, Target1
gate_2 = StreamGate(Stream=disc.Points, Gate=get_boolean)  # -> Target0, Target1
con = DelaunayEdges(Points=gate_2.Target0, Plane=PlaneXY(0, 0, 0))  # -> Connectivity, Edges
curvepoint = PointOnCurve(con.Edges, parameter=0.5)
brec = BoundingRectangle(Geometry=gate.Target1, Plane=PlaneXY(0, 0, 0), Axis=0, Slide=0, Union=False)  # -> Bounding, DimensionX, DimensionY
incurve = PointInCurve(Point=curvepoint, Curve=graft(flip_2.Curve))  # -> Relationship, Point
cir_2 = Circle(Plane=disc.Points, Radius=1)
flip_3 = FlipCurve(Curve=brec.Bounding, Guide=flip.Curve)  # -> Curve, Flag
equals = Equality(FirstNumber=incurve.Relationship, SecondNumber=2)  # -> Equality, Inequality
get_number = GetNumber(
    "1",
    AtLeast=1,
    AtMost=1,
    Maximum=1.797693135e+308,
    Minimum=-1.797693135e+308,
    Prompt="Offset distance for exterior dimensions")
get_string = GetString("default", AtLeast=1, AtMost=1, Prompt="Annotation Style Name")
ccx = CurveCurve(CurveA=cir_2, CurveB=graft(flip_2.Curve))  # -> Points, ParamsA, ParamsB
disc_2 = Discontinuity(Curve=flip_3.Curve, Level=1)  # -> Points, Parameters
get_number_2 = GetNumber(
    Slider(1, range=0..1),
    AtLeast=1,
    AtMost=1,
    Maximum=1.797693135e+308,
    Minimum=-1.797693135e+308,
    Prompt="Offset distance for angle dimensions")
cull = CullPattern(List=con.Edges, CullPattern=equals.Equality)
item = ListItem(List=ccx.Points, Index=0, Wrap=True)  # -> Item, Item1
shift = ShiftList(List=disc_2.Points, Shift=1, Wrap=True)
shift_2 = ShiftList(List=disc.Points, Shift=1, Wrap=True)
end = EndPoints(Curve=cull)  # -> Start, End
angulardim = DefineAngularDimension(Origin=graft(gate_2.Target1), Point1=item.Item1, Point2=item.Item, Offset=get_number_2, DimensionStyle="Default")
lineardim = DefineLinearDimension(Point1=disc_2.Points, Point2=shift, Offset=expr("x*2", get_number), DimensionStyle=get_string)
lineardim_2 = DefineLinearDimension(Point1=disc.Points, Point2=shift_2, Offset=get_number, DimensionStyle=get_string)
lineardim_3 = DefineLinearDimension(Point1=end.Start, Point2=end.End, Offset=0, DimensionStyle=get_string)
pshift = ShiftPaths(Data=angulardim, Offset=-1)
group = Group(Objects=simplify(flatten(brec.Bounding)))
group_2 = Group(Objects=lineardim)
group_3 = Group(Objects=lineardim_2)
group_4 = Group(Objects=lineardim_3)
group_5 = Group(Objects=pshift)
context_bake = ContextBake(Geometry=group_2)
context_bake_2 = ContextBake(Geometry=group)
context_bake_3 = ContextBake(Geometry=group_3)
context_bake_4 = ContextBake(Geometry=group_4)
context_bake_5 = ContextBake(Geometry=group_5)
