# Grasshopper definition ifelseconditionstatement.gh (Grasshopper 0.8.51)

series = Series(Start="-10", Step=1, Count="35")
panel = Panel(series)
larger = LargerThan(FirstNumber="-5", SecondNumber=panel)  # -> LargerThan, OrEqualTo
smaller = SmallerThan(FirstNumber="15", SecondNumber=panel)  # -> SmallerThan, OrEqualTo
equals = Equality(FirstNumber=larger.LargerThan, SecondNumber=smaller.SmallerThan)  # -> Equality, Inequality
cull = CullPattern(List=panel, CullPattern=larger.LargerThan)
cull_2 = CullPattern(List=panel, CullPattern=equals.Equality)
cull_3 = CullPattern(List=panel, CullPattern=smaller.SmallerThan)
panel_2 = Panel(cull)
panel_3 = Panel(cull_2)
panel_4 = Panel(cull_3)
