# Grasshopper definition reduce.ghx (Grasshopper 0.6.59)

range = Range(D=Domain(0, 1), N=10)
range_2 = Range(D=Domain(0, 1), N=10)
lng = ListLength(L=range)
minus = Subtraction(A=lng, B="1")
dom = Domain(A="1", B=minus)
vb = DotNETVBScript(x=range_2, y=Slider(5, range=0..5))  # -> out, A; inputs x: list
# ---------- vb: VB ----------
    Dim myList As New List(Of Object)

    For i As Integer = 0 To x.Count - 1 - y
      myList.Add(x(i))
    Next

    A = myList
# ---------- end vb ----------
subset = SubList(L=range, I=dom, C=False)  # -> L, I
panel = Panel(vb.A)
panel_2 = Panel(range)
panel_3 = Panel(subset.L)
