# Grasshopper definition model_divider.gh (Grasshopper 1.0.4)

pt = ConstructPoint(XCoordinate=Slider(20, range=0..100), YCoordinate=Slider(20, range=0..100), ZCoordinate=0)
rectangle = Rectangle(Plane=pt, XSize=Slider(500, range=0..1000), YSize=Slider(500, range=0..1000), Radius=0)  # -> Rectangle, Length
boxrec = BoxRectangle(Rectangle=rectangle.Rectangle, Height=Slider(500, range=0..1000))
split = SplitBrep(Brep=boxrec)
