# Grasshopper definition count_definition_for_rectangle.gh (Grasshopper 1.0.4)

pt = ConstructPoint(XCoordinate=Slider(83, range=0..200), YCoordinate=Slider(91, range=0..200), ZCoordinate=0)

panel = Panel("""100
200""")
panel_2 = Panel("""400
600""")
panel_3 = Panel("""2
4""")
panel_4 = Panel(pt)
rectangle = Rectangle(Plane=panel_4, XSize=panel, YSize=panel_2, Radius=[2, 4])  # -> Rectangle, Length

seq = Sequence(Notation="[N-1] + [N-2]", Length=20, Initial=[1, 1])
repeat = RepeatData(Data=panel_3, Length=panel_3)
