# Grasshopper definition csv_reader.gh (Grasshopper 1.0.4)
# plug-ins: EleFront, LunchBox

file = ReadFile(File="C:\Users\user\Documents\work_orders\68_order.csv", PerLineParse=True)
csv = ReadCSV(CSVString=file, Delimiter=";")  # -> Headers, Values
bang = ExplodeTree(Data=csv.Values)  # -> Branch0, Branch1, Branch2
panel = Panel(bang.Branch1)
panel_2 = Panel(bang.Branch2)
panel_3 = Panel(bang.Branch0)

series = Series(Start=10, Step=Slider(821, range=0..10000), Count=expr("46", 10))
pt = ConstructPoint(XCoordinate=series, YCoordinate=0, ZCoordinate=0)
rectangle = Rectangle(Plane=pt, XSize=panel_2, YSize=panel, Radius=0)  # -> Rectangle, Length
bake = BakeObjects(Geometry=rectangle.Rectangle, Bake=False)
