# Grasshopper definition multiple_rifle.gh (Grasshopper 1.0.4)

# ----
# rifle
y = Panel("500")
number_slider = Slider(100, range=0..100)
x = Panel("576")
pt = ConstructPoint(XCoordinate=number_slider, YCoordinate=number_slider, ZCoordinate=0)
rectangle = Rectangle(Plane=pt, XSize=x, YSize=y, Radius=0)  # -> Rectangle, Length
_20 = Number(20)
integer_division = IntegerDivision(A=x, B=_20)
list = ValueList({"1", "2", "3", "4"}, selected="1")
pdecon = Deconstruct(Point=pt)  # -> XComponent, YComponent, ZComponent
_10 = Number(10)
subtraction = Subtraction(A=integer_division, B=list)
python = GhPythonScript(x=x, amount_of_lines=subtraction)  # -> rifle_x_size, step_between_lines
# ---------- python: Python ----------
import rhinoscriptsyntax as rs

x = int(x)
aol = amount_of_lines

aol = (aol * 2) - 1
rifle_x_size = (x - 20) / aol / 10
step_between_lines = rifle_x_size * 20

print(aol)
print(rifle_x_size)
print(step_between_lines)
# ---------- end python ----------
addition = Addition(A=pdecon.XComponent, B=_10)
_5 = Number(5)
series = Series(Start_position=addition, Step_between_lines=python.step_between_lines, Count_of_lines=subtraction)
subtraction_2 = Subtraction(Y_coordinate=number_slider, B=_5)
pt_2 = ConstructPoint(XCoordinate=series, YCoordinate=subtraction_2, ZCoordinate=0)
_10_2 = Number(10)
addition_2 = Addition(Y_size=y, B=_10_2)
rectangle_2 = Rectangle(Plane=pt_2, XSize=_10, YSize=addition_2, Radius=0)  # -> Rectangle, Length
scale_nu = ScaleNU(Geometry=rectangle_2.Rectangle, Plane=pt_2, ScaleX=python.rifle_x_size, ScaleY=1, ScaleZ=1)  # -> Geometry, Transform
baker = Merge(Data1=scale_nu.Geometry, Data2=rectangle.Rectangle)
bang = ExplodeTree(Data=baker)  # -> Branch0, Branch1
tstat = TreeStatistics(Tree=bang.Branch1)  # -> Paths, Length, Count
main_rectangle_size = Panel(bang.Branch0)
amount = Panel(tstat.Length)
