# Grasshopper definition new_rifle_logic_fork.gh (Grasshopper 1.0.4)

# ----
# control group
x_start_point = Slider(-750, range=-3000..3000)
y_start_point = Slider(3000, range=-5000..3000)
x_size = Slider(368, range=0..1000)
y_size = Slider(279, range=0..3000)

ghpython_script = GhPythonScript(x_size=x_size)  # -> x_line_size
# ---------- ghpython_script: Python ----------
# Построение логики для автоматизации рифлёнки.

x_size = int(x_size)

# aol = amount of lines
aol = x_size // 10


step = x_size - (aol * 10) 
x_line_size = int(step) / aol 
x_line_size = x_line_size + 10

print(step)
print(x_line_size)
# ---------- end ghpython_script ----------
integer_division = IntegerDivision(A=x_size, _10=10)
division = Division(X_line_size=ghpython_script, _10=10)
series = Series(X_start_point=x_start_point, StepX_line_size=ghpython_script, Amount_of_lines=integer_division)
main_rectangle_position = ConstructPoint(XCoordinate=x_start_point, YCoordinate=y_start_point, ZCoordinate=0)
subtraction = Subtraction(Y_start_point=y_start_point, B=5)
construct_point = ConstructPoint(XCoordinate=series, YCoordinate=subtraction, ZCoordinate=0)
addition = Addition(Y_size=y_size, _10=10)
rectangle = Rectangle(Plane=main_rectangle_position, XSize=x_size, YSize=y_size, Radius=0)  # -> Rectangle, Length
rectangle_2 = Rectangle(Plane=construct_point, X_size_10=Domain(0, 10), Y_size10=addition, Radius=0)  # -> Rectangle, Length
scale_nu = ScaleNU(Geometry=rectangle_2.Rectangle, Plane=construct_point, ScaleX=division, ScaleY=1, ScaleZ=1)  # -> Geometry, Transform

baker = Merge(Data1=rectangle.Rectangle, Data2=scale_nu.Geometry)
list_length = ListLength(List=construct_point)
panel = Panel(list_length)

ghpython_script_2 = GhPythonScript(num=panel)  # -> out; inputs num: Int32
# ---------- ghpython_script_2: Python ----------
import rhinoscriptsyntax as rs

if num % 2 == 0:
    print(int(1))

else:
    print(int(0))
# ---------- end ghpython_script_2 ----------
panel_2 = Panel(ghpython_script_2)
equality = Equality(FirstNumber=panel_2, SecondNumber=1)  # -> Equality, Inequality
