# Grasshopper definition new_rifle_logic_main [Nov-24 '22, 1623].gh (Grasshopper 1.0.4)

number_slider = Slider(20, range=0..100)
number_slider_2 = Slider(20, range=0..100)
x_size = Panel("271")
y_size = Panel("400")
python = GhPythonScript(x=x_size)  # -> x_line_size
# ---------- python: Python ----------
# Построение логики для автоматизации рифлёнки.

x = int(x)

# aol = amount of lines
aol = x // 10


step = x - (aol * 10) 
x_line_size = int(step) / aol 
x_line_size = x_line_size + 10

print(step)
print(x_line_size)
# ---------- end python ----------
integer_division = IntegerDivision(A=x_size, _10=10)
subtraction = Subtraction(A=number_slider_2, B=5)
series = Series(Start=number_slider, Step=python, Count=integer_division)
addition = Addition(A=y_size, B=10)
pt = ConstructPoint(XCoordinate=number_slider, YCoordinate=number_slider_2, ZCoordinate=0)
pt_2 = ConstructPoint(XCoordinate=series, YCoordinate=subtraction, ZCoordinate=0)
rectangle = Rectangle(Plane=pt, XSize=x_size, YSize=y_size, Radius=0)  # -> Rectangle, Length
rectangle_2 = Rectangle(Plane=pt_2, XSize=Slider(10, range=0..10), YSize=addition, Radius=0)  # -> Rectangle, Length
division = Division(A=python, B=10)
scale_nu = ScaleNU(Geometry=rectangle_2.Rectangle, Plane=pt_2, ScaleX=division, ScaleY=1, ScaleZ=1)  # -> Geometry, Transform
