# Grasshopper definition rectangle_by_list.gh (Grasshopper 1.0.4)

# ----
# rifle
x_size = Slider(448, range=0..3100)
number_slider = Slider(279, range=0..3100)
pt = ConstructPoint(XCoordinate=x_size, YCoordinate=x_size, ZCoordinate=0)
rectangle = Rectangle(Plane=pt, XSize=x_size, YSize=number_slider, Radius=0)  # -> Rectangle, Length
_20 = Number(20)
pdecon = Deconstruct(Point=pt)  # -> XComponent, YComponent, ZComponent
integer_division = IntegerDivision(A=x_size, B=_20)
list = ValueList({"1", "2", "3", "4"}, selected="1")
_10 = Number(10)
addition = Addition(A=pdecon.XComponent, B=_10)
subtraction = Subtraction(A=integer_division, B=list)
python = GhPythonScript(x=x_size, amount_of_lines=subtraction)  # -> rifle_x_size, step_between_lines
# ---------- python: Python ----------
import rhinoscriptsyntax as rs

x = int(x)
aol = amount_of_lines

aol = (aol * 2) - 1
rifle_x_size = (x - 20) / aol / 10
step_between_lines = rifle_x_size * 20

print(aol)
print(rifle_x_size)
print(step_between_lines)
# ---------- end python ----------
series = Series(Start_position=addition, Step_between_lines=python.step_between_lines, Count_of_lines=subtraction)
_5 = Number(5)
subtraction_2 = Subtraction(Y_coordinate=x_size, B=_5)
pt_2 = ConstructPoint(XCoordinate=series, YCoordinate=subtraction_2, ZCoordinate=0)
_10_2 = Number(10)
addition_2 = Addition(Y_size=number_slider, B=_10_2)
rectangle_2 = Rectangle(Plane=pt_2, XSize=_10, YSize=addition_2, Radius=0)  # -> Rectangle, Length
scale_nu = ScaleNU(Geometry=rectangle_2.Rectangle, Plane=pt_2, ScaleX=python.rifle_x_size, ScaleY=1, ScaleZ=1)  # -> Geometry, Transform
baker = Merge(Data1=scale_nu.Geometry, Data2=rectangle.Rectangle)
bang = ExplodeTree(Data=baker)  # -> Branch0, Branch1
tstat = TreeStatistics(Tree=bang.Branch1)  # -> Paths, Length, Count
main_rectangle_size = Panel(bang.Branch0)
amount = Panel(tstat.Length)

# ----
# Modern
python_2 = GhPythonScript()  # -> out, x, y
# ---------- python_2: Python ----------
import rhinoscriptsyntax as rs


# 59_order

# 1 list
x = [ 647, 597, 647, 597, 597, 95, 95, 95, 130, 130, 130, 130, 130, 497, 497, 130, 100, 130, 100, 450, 434, 598, 270, 254, 497 ]
y = [ 947, 723, 723, 359, 177, 1800, 2280, 570, 1200, 1850, 400, 600, 400, 547, 2037, 2000, 2000, 584, 584, 600, 200, 196, 1000, 184, 181]

# 2 list
x = x + [ 489, 489, 489, 100, 100, 100, 140, 140, 140, 70, 467, 467, 100, 140, 100, 40, 40, 140]
y = y + [ 595, 1997, 1997, 1476, 1540, 584, 584, 1476, 1540, 2600, 2097, 2097, 584, 584, 1450, 2100, 600, 1450 ]

print('done!')
# ---------- end python_2 ----------
X = Panel(python_2.x)
number_slider_2 = Slider(1000, range=0..1000)
number_slider_3 = Slider(3, range=0..10)
Y = Panel(python_2.y)
tstat_2 = TreeStatistics(Tree=X)  # -> Paths, Length, Count
series_2 = Series(Start0=expr("0", number_slider_2), Step=number_slider_2, Count=tstat_2.Length)
pt_3 = ConstructPoint(XCoordinate=series_2, YCoordinate=0, ZCoordinate=0)
rectangle_3 = Rectangle(Plane=pt_3, XSize=X, YSize=Y, Radius=0)  # -> Rectangle, Length

# ----
# Quadro s
number_slider_4 = Slider(577, range=-3000..3000)
y_size = Slider(1396, range=0..3000)
x_size_2 = Slider(1131, range=0..3000)
X_2 = Panel("500")
Y_2 = Panel("500")
_50 = Number(50)
_72 = Number(72)
_48 = Number(48)
X_3 = UnitX(Factor=_48)
Y_3 = UnitY(Factor=_48)
multiplication = Multiplication(_48=_48, B=2)
X_4 = UnitX(Factor=_50)
Y_4 = UnitY(Factor=_50)
multiplication_2 = Multiplication(_50=_50, B=2)
X_5 = UnitX(Factor=_72)
Y_5 = UnitY(Factor=_72)
multiplication_3 = Multiplication(_72=_72, B=2)
subtraction_3 = Subtraction(Main_x_size=X_2, Rec_size_x_2=multiplication)
subtraction_4 = Subtraction(Main_y_size=Y_2, Rec_size_x_2=multiplication)
subtraction_5 = Subtraction(Main_x_size=X_2, Rec_size_x_2=multiplication_2)
subtraction_6 = Subtraction(Main_y_size=Y_2, Rec_size_x_2=multiplication_2)
subtraction_7 = Subtraction(Main_x_size=X_2, Rec_size_x_2=multiplication_3)
subtraction_8 = Subtraction(Main_y_size=Y_2, Rec_size_x_2=multiplication_3)

tstat_3 = TreeStatistics(Tree=X_2)  # -> Paths, Length, Count

series_3 = Series(Start=number_slider_4, Step=number_slider_4, Count=tstat_3.Length)
start_point = ConstructPoint(XCoordinate=series_3, YCoordinate=Slider(0, range=-3000..3000), ZCoordinate=0)
addition_3 = Addition(Handle_width_x=X_3, Main_rectangle_start_point=start_point, Handle_width_y=Y_3)
addition_4 = Addition(Handle_width_x=X_4, Main_rectangle_start_point=start_point, Handle_width_y=Y_4)
addition_5 = Addition(Handle_width_x=X_5, Main_rectangle_start_point=start_point, Handle_width_y=Y_5)
main_rectangle = Rectangle(Plane=start_point, XSize=X_2, YSize=Y_2, Radius=0)  # -> Rectangle, Length
rectangle_4 = Rectangle(Plane=addition_3, XSize=subtraction_3, YSize=subtraction_4, Radius=0)  # -> Rectangle, Length
rectangle_5 = Rectangle(Plane=addition_4, XSize=subtraction_5, YSize=subtraction_6, Radius=0)  # -> Rectangle, Length
rectangle_6 = Rectangle(Plane=addition_5, XSize=subtraction_7, YSize=subtraction_8, Radius=0)  # -> Rectangle, Length
baker_2 = Merge(Data1=main_rectangle.Rectangle, Data2=rectangle_4.Rectangle, Data3=rectangle_5.Rectangle, Data4=rectangle_6.Rectangle)
panel = Panel(baker_2)
