# Grasshopper definition rifle+viborka_main_python_move.gh (Grasshopper 1.0.4)
# plug-ins: Bifocals

linear_array = LinearArray(Direction=Vector(10, 0, 0), Count=10)  # -> Geometry, Transform

# ----
# Main parameters
main_x_coordinate = Slider(0, range=0..3000)
main_y_coordinate = Slider(0, range=0..3000)
main_rectangle_x_size = Slider(500, range=0..3000)
main_rectangle_y_size = Slider(1000, range=0..3000)
rifle_length = Slider(200, range=1..1000)

# ----
# main
# rectangle
main_rectangle_position = ConstructPoint(XCoordinate=main_x_coordinate, YCoordinate=main_y_coordinate, ZCoordinate=0)
main_rectangle = Rectangle(Plane=main_rectangle_position, XSize=main_rectangle_x_size, YSize=main_rectangle_y_size, Radius=0)  # -> Rectangle, Length

# ----
# viborka rectangle
# position
# viborka
# rectangle
deconstruct = Deconstruct(Main_rectangle_start_point=main_rectangle_position)  # -> XComponent, YComponent, ZComponent

ghpython_script = GhPythonScript(
    rifle_length=rifle_length,
    main_x_coordinate=main_x_coordinate,
    main_y_coordinate=main_y_coordinate,
    main_rectangle_x_size=main_rectangle_x_size,
    main_rectangle_y_size=main_rectangle_y_size,
    test_point=main_rectangle_position,
    viborka_x_point=deconstruct.XComponent,
    viborka_y_point=deconstruct.YComponent)  # -> out, viborka_x_size, viborka_y_size, viborka_x_point_res, viborka_y_point_res, end_line_x_dot_1, end_line_y_dot_1, end_line_x_dot_2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
# ---------- ghpython_script: Python ----------
# Совместить оба блока с питоновым кодом в один массивный. По возможности
# перенести максимум элементов из grasshopper в python.

import rhinoscriptsyntax as rs

# Блок с viborka rectangle:

viborka_x_size = main_rectangle_x_size - 120
viborka_y_size = float(main_rectangle_y_size) - float(rifle_length) - float(120)

viborka_x_size = float(viborka_x_size) 
viborka_y_size = float(viborka_y_size)

print()
print("Ширина выборки: ")
print(viborka_x_size)
print()
print("Высота выборки: ")
print(viborka_y_size)
print()

# Стартовая точка для выборки:

viborka_x_point_res = viborka_x_point + 60
viborka_y_point_res = viborka_y_point + 60

# Rifle end line block

# start_point:
end_line_x_dot_1 = main_x_coordinate - 5
end_line_y_dot_1 = main_y_coordinate + main_rectangle_y_size - rifle_length

# end_point:
end_line_x_dot_2 = main_x_coordinate + main_rectangle_x_size + 5
end_line_y_dot_2 = main_y_coordinate + main_rectangle_y_size - rifle_length

# rifle (rifle lines)

amount_of_lines = main_rectangle_x_size // 10
amount_of_lines = int(amount_of_lines)

rifle_y_start_point = main_rectangle_y_size - rifle_length

# Логика с формированием рифлёнки. Основная задача состоит в том, чтобы сделать
# такую логику, которая при чётном значении переменной list_lenght удаляет
# последнюю точку в списке и соответствующим образом меняет прочие параметры.

# Построение логики для автоматизации рифлёнки.

rifle_step = main_rectangle_x_size - (amount_of_lines * 10) 
rifle_x_line_size = int(rifle_step) / amount_of_lines
rifle_x_line_size = rifle_x_line_size + 10
rifle_x_scaling = rifle_x_line_size / 10

rifle_start_position_y = main_rectangle_y_size - rifle_length
rifle_start_position_y = rifle_start_position_y +  main_y_coordinate + 1
rifle_start_position_y = float(rifle_start_position_y)

rifle_y_size = rifle_length + 4
rifle_y_size = int(rifle_y_size)

print()
print("Кол-во рифлёнок: ")
print(amount_of_lines)
print()
print("Множитель (для компонента scaling)")
print(rifle_x_scaling)
print()

# if list_lenght % 2 == 0:
#     print(int(1))
# else:
#     print(int(0))
# ---------- end ghpython_script ----------

# ----
# Rifle
series = Series(
    Main_x_coordinate=main_x_coordinate,
    Rifle_x_line_size=ghpython_script.rifle_x_line_size,
    Amount_of_lines=ghpython_script.amount_of_lines)
rifle_start_position = ConstructPoint(XCoordinate=series, YCoordinate=ghpython_script.rifle_start_position_y, ZCoordinate=0)
cull_pattern = CullPattern(List=rifle_start_position, CullPattern=[False, True, False, True])
rectangle = Rectangle(Plane=cull_pattern, X_size10=Domain(0, 10), YSize=ghpython_script.rifle_y_size, Radius=0)  # -> Rectangle, Length
scale_nu = ScaleNU(Geometry=rectangle.Rectangle, Plane=cull_pattern, ScaleX=ghpython_script.rifle_x_scaling, ScaleY=1, ScaleZ=1)  # -> Geometry, Transform

debug_panel = Panel(ghpython_script.out)

main_rectangle_position_2 = ConstructPoint(XCoordinate=ghpython_script.viborka_x_point_res, YCoordinate=ghpython_script.viborka_y_point_res, ZCoordinate=0)
viborka_rectangle = Rectangle(Plane=main_rectangle_position_2, XSize=ghpython_script.viborka_x_size, YSize=ghpython_script.viborka_y_size, Radius=0)  # -> Rectangle, Length

# ----
# Rifle end line
construct_point = ConstructPoint(XCoordinate=ghpython_script.end_line_x_dot_1, YCoordinate=ghpython_script.end_line_y_dot_1, ZCoordinate=0)
construct_point_2 = ConstructPoint(XCoordinate=ghpython_script.end_line_x_dot_2, YCoordinate=ghpython_script.end_line_y_dot_2, ZCoordinate=0)
line = Line(StartPoint=construct_point, EndPoint=construct_point_2)

baker = Merge(Data1=main_rectangle.Rectangle, Data2=viborka_rectangle.Rectangle, Data3=line, Data4=scale_nu.Geometry)
