# Grasshopper definition rifle+viborka_main_v0.2.gh (Grasshopper 1.0.4)

linear_array = LinearArray(Direction=Vector(10, 0, 0), Count=10)  # -> Geometry, Transform

# ----
# Main parameters
main_x_coordinate = Slider(0, range=0..3000)
main_y_coordinate = Slider(0, range=0..3000)
main_rectangle_x_size = Slider(827, range=0..3000)
main_rectangle_y_size = Slider(1219, range=0..3000)
rifle_length = Slider(250, range=1..1000)

# ----
# main
# rectangle
main_rectangle_position = ConstructPoint(XCoordinate=main_x_coordinate, YCoordinate=main_y_coordinate, ZCoordinate=0)
main_rectangle = Rectangle(Plane=main_rectangle_position, XSize=main_rectangle_x_size, YSize=main_rectangle_y_size, Radius=0)  # -> Rectangle, Length

# ----
# viborka rectangle
# position
deconstruct = Deconstruct(Point=main_rectangle_position)  # -> XComponent, YComponent, ZComponent
_60 = Number(60)
addition = Addition(A=deconstruct.XComponent, B=_60)
addition_2 = Addition(A=deconstruct.XComponent, B=_60)
main_rectangle_position_2 = ConstructPoint(XCoordinate=addition, YCoordinate=addition_2, ZCoordinate=0)

# ----
# viborka
# rectangle
_120 = Number(120)
subtraction = Subtraction(Main_rectangle_x_size=main_rectangle_x_size, _120=_120)
subtraction_2 = Subtraction(Main_rectangle_y_size=main_rectangle_y_size, _120=_120, Rifle_length=rifle_length)
viborka_rectangle = Rectangle(Plane=main_rectangle_position_2, XSize=subtraction, YSize=subtraction_2, Radius=0)  # -> Rectangle, Length

# ----
# Rifle
integer_division = IntegerDivision(Main_rectangle_x_size=main_rectangle_x_size, _10=10)
subtraction_3 = Subtraction(Main_rectangle_y_size=main_rectangle_y_size, Rifle_length=rifle_length)
addition_3 = Addition(Main_y=subtraction_3, C=1)
ghpython_script = GhPythonScript(main_rectangle_x_size=main_rectangle_x_size)  # -> x_line_size
# ---------- ghpython_script: Python ----------
# Построение логики для автоматизации рифлёнки.

x_size = main_rectangle_x_size

x_size = int(x_size)

# aol = amount of lines
aol = x_size // 10


step = x_size - (aol * 10) 
x_line_size = int(step) / aol 
x_line_size = x_line_size + 10

print(step)
print(x_line_size)
# ---------- end ghpython_script ----------
series = Series(Main_x_coordinate=main_x_coordinate, StepX_line_size=ghpython_script, Amount_of_lines=integer_division)
rifle_start_position = ConstructPoint(XCoordinate=series, YCoordinate=addition_3, ZCoordinate=0)
addition_4 = Addition(Rifle_length=rifle_length, B=4)
division = Division(X_line_size=ghpython_script, _10=10)
cull_pattern = CullPattern(List=rifle_start_position, CullPattern=[False, True, False, True])
rectangle = Rectangle(Plane=cull_pattern, XSize=Domain(0, 10), YSize=addition_4, Radius=0)  # -> Rectangle, Length
scale_nu = ScaleNU(Geometry=rectangle.Rectangle, Plane=cull_pattern, ScaleX=division, ScaleY=1, ScaleZ=1)  # -> Geometry, Transform

# ----
# Rifle end line
subtraction_4 = Subtraction(Main_x_coordinate=main_x_coordinate, B=5)
addition_5 = Addition(Main_y_coordinate=main_y_coordinate, Main_rectangle_y_size=main_rectangle_y_size)
addition_6 = Addition(Main_x_coordinate=main_x_coordinate, Main_x_size=main_rectangle_x_size, C=5)
addition_7 = Addition(Main_y_coordinate=main_y_coordinate, Main_rectangle_y_size=main_rectangle_y_size)
subtraction_5 = Subtraction(A=addition_5, Rifle_length=rifle_length)
subtraction_6 = Subtraction(A=addition_7, Rifle_length=rifle_length)
construct_point = ConstructPoint(XCoordinate=subtraction_4, YCoordinate=subtraction_5, ZCoordinate=0)
construct_point_2 = ConstructPoint(XCoordinate=addition_6, YCoordinate=subtraction_6, ZCoordinate=0)
line = Line(StartPoint=construct_point, EndPoint=construct_point_2)

baker = Merge(Data1=main_rectangle.Rectangle, Data2=viborka_rectangle.Rectangle, Data3=line, Data4=scale_nu.Geometry)
list_length = ListLength(List=rifle_start_position)
panel = Panel(list_length)
ghpython_script_2 = GhPythonScript(list_lenght=panel, dot_list=rifle_start_position)  # -> out, fine_dot_list; inputs list_lenght: Int32, dot_list: list of Point3d
# ---------- ghpython_script_2: Python ----------
import rhinoscriptsyntax as rs
import Grasshopper

if list_lenght % 2 == 0:
    print(int(1))
else:
    print(int(0))

print()
print(list(dot_list))
print()
# ---------- end ghpython_script_2 ----------
panel_2 = Panel(ghpython_script_2.fine_dot_list)
debug_panel = Panel(ghpython_script_2.out)
