# Grasshopper definition rifle_test_fork.gh (Grasshopper 1.0.4)

x = Panel("800")
y = Panel("500")
number_slider = Slider(100, range=0..100)
_10 = Number(10)
_20 = Number(20)
integer_division = IntegerDivision(A=x, B=_20)
subtraction = Subtraction(A=integer_division, B=2)
# Структура для автоматического
# масштабирования линий рифлёнки
multiplication = Multiplication(_20=_20, Number_of_line_repeats=subtraction)
_5 = Number(5)
pt = ConstructPoint(XCoordinate=number_slider, YCoordinate=number_slider, ZCoordinate=0)
pdecon = Deconstruct(Point=pt)  # -> XComponent, YComponent, ZComponent
addition = Addition(A=pdecon.XComponent, B=_10)
series = Series(Start_position=addition, Step_between_lines=_20, Count_of_lines=subtraction)
subtraction_2 = Subtraction(Y_coordinate=number_slider, B=_5)
subtraction_3 = Subtraction(A=multiplication, _10=_10)
rectangle = Rectangle(Plane=pt, XSize=x, YSize=y, Radius=0)  # -> Rectangle, Length
subtraction_4 = Subtraction(X_size=x, B=subtraction_3)
pt_2 = ConstructPoint(XCoordinate=series, YCoordinate=subtraction_2, ZCoordinate=0)
_10_2 = Number(10)
addition_2 = Addition(Y_size=y, B=_10_2)
rectangle_2 = Rectangle(Plane=pt_2, XSize=_10, YSize=addition_2, Radius=0)  # -> Rectangle, Length
scale_nu = ScaleNU(Geometry=rectangle_2.Rectangle, Plane=pt_2, ScaleX=Slider(1.04, range=0..10), ScaleY=1, ScaleZ=1)  # -> Geometry, Transform
