# Grasshopper definition rifle_test_fork_0.2.gh (Grasshopper 1.0.4)

y = Panel("500")
number_slider = Slider(100, range=0..100)
x = Panel("666")
subtraction = Subtraction(X_size=x, B=20)
pt = ConstructPoint(XCoordinate=number_slider, YCoordinate=number_slider, ZCoordinate=0)
rectangle = Rectangle(Plane=pt, XSize=x, YSize=y, Radius=0)  # -> Rectangle, Length
_20 = Number(20)
integer_division = IntegerDivision(A=x, B=_20)
list = ValueList({"1", "2", "3", "4"}, selected="1")
pdecon = Deconstruct(Point=pt)  # -> XComponent, YComponent, ZComponent
_10 = Number(10)
subtraction_2 = Subtraction(A=integer_division, B=list)
# Структура для автоматического
# масштабирования линий рифлёнки
multiplication = Multiplication(A=2, Number_of_line_repeats=subtraction_2)
subtraction_3 = Subtraction(A=multiplication, B=1)
division = Division(A=subtraction, B=subtraction_3)
division_2 = Division(A=division, _10=10)
multiplication_2 = Multiplication(A=division_2, _20=20)
addition = Addition(A=pdecon.XComponent, B=_10)
_5 = Number(5)
series = Series(Start_position=addition, Step_between_lines=multiplication_2, Count_of_lines=subtraction_2)
subtraction_4 = Subtraction(Y_coordinate=number_slider, B=_5)
pt_2 = ConstructPoint(XCoordinate=series, YCoordinate=subtraction_4, ZCoordinate=0)
_10_2 = Number(10)
addition_2 = Addition(Y_size=y, B=_10_2)
rectangle_2 = Rectangle(Plane=pt_2, XSize=_10, YSize=addition_2, Radius=0)  # -> Rectangle, Length
scale_nu = ScaleNU(Geometry=rectangle_2.Rectangle, Plane=pt_2, ScaleX=division_2, ScaleY=1, ScaleZ=1)  # -> Geometry, Transform
