# Grasshopper definition oxford_vitrini.gh (Grasshopper 1.0.4)

main_coordinate = Slider(0, range=0..100)
x_size = Slider(1248, range=0..2000)
y_size = Slider(446, range=0..1000)
number_slider = Slider(120, range=0..1000)
number_slider_2 = Slider(120, range=0..1000)

pt = ConstructPoint(XCoordinate=main_coordinate, YCoordinate=main_coordinate, ZCoordinate=0)
main_rectangle = Rectangle(Plane=pt, XSize=x_size, YSize=y_size, Radius=0)  # -> Rectangle, Length
addition = Addition(A=main_coordinate, B=74.85)
offset = OffsetCurve(Curve=main_rectangle.Rectangle, Distance=-65.35, Plane=PlaneXY(0, 0, 0), Corners=1)
addition_2 = Addition(A=main_coordinate, B=74.85)
offset_2 = OffsetCurve(Curve=offset, Distance=-1, Plane=PlaneXY(0, 0, 0), Corners=1)
pt_2 = ConstructPoint(XCoordinate=addition, YCoordinate=addition_2, ZCoordinate=0)
subtraction = Subtraction(A=x_size, B=150.7)
subtraction_2 = Subtraction(A=y_size, B=150.7)
offset_3 = OffsetCurve(Curve=offset_2, Distance=-6, Plane=PlaneXY(0, 0, 0), Corners=1)
offset_4 = OffsetCurve(Curve=offset_3, Distance=-3, Plane=PlaneXY(0, 0, 0), Corners=1)

bake_all = Merge(Data1=main_rectangle.Rectangle, Data3=offset, Data4=offset_2, Data5=offset_3, Data6=offset_4)

rectangle = Rectangle(Plane=pt_2, XSize=subtraction, YSize=subtraction_2, Radius=0)  # -> Rectangle, Length
